# Grasshopper definition Rotate.gh (Grasshopper 1.0.7)

num_floors = Slider(20, range=0..20)
rotation = Slider(6, range=0..30)
radius1 = GetNumber(Slider(15, range=0..50), AtLeast=1, AtMost=2147483647, Maximum=1.797693135e+308, Minimum=-1.797693135e+308)
radius2 = GetNumber(Slider(34, range=0..50), AtLeast=1, AtMost=2147483647, Maximum=1.797693135e+308, Minimum=-1.797693135e+308)
num_floors_2 = GetNumber(num_floors, AtLeast=1, AtMost=2147483647, Maximum=1.797693135e+308, Minimum=-1.797693135e+308)
rotation_2 = GetNumber(rotation, AtLeast=1, AtMost=2147483647, Maximum=1.797693135e+308, Minimum=-1.797693135e+308)
floor_to_floor = Slider(8, range=0..20)
pt = ConstructPoint(XCoordinate=0, YCoordinate=0, ZCoordinate=0)
ellipse = Ellipse(Plane=pt, Radius1=radius1, Radius2=radius2)  # -> Ellipse, Focus1, Focus2
series = Series(Start=0, Step=floor_to_floor, Count=num_floors_2)
series_2 = Series(Start=0, Step=rotation_2, Count=num_floors_2)
circle = Circle(Plane=pt, Radius=Slider(98, range=0..100))
Z = UnitZ(Factor=series)
rad = Radians(Degrees=series_2)
move = Move(Geometry=ellipse.Ellipse, Motion=Z)  # -> Geometry, Transform
boundary_surfaces = BoundarySurfaces(Edges=circle)
rotate = Rotate(Geometry=move.Geometry, Angle=rad, Plane=PlaneXY(0, 0, 0))  # -> Geometry, Transform

Z_2 = UnitZ(Factor=floor_to_floor)
extr = Extrude(Base=rotate.Geometry, Direction=Z_2)
cap = CapHoles(Brep=extr)

# ---- group: RH_OUT:mesh
mesh_brep = MeshBrep(
    Brep=[cap, boundary_surfaces],
    Settings={GridMaxCount=0, GridMinCount=16, JaggedSeams=False, MaxEdgeLength=0, MinEdgeLength=0.0001, MinTolerance=0, Refine=True, RefineAngle=0, RelativeTolerance=0.65, SimplePlanes=True, Tolerance=0})
